# Grasshopper definition receiver.gh (Grasshopper 0.9.76)
# plug-ins: Python Interpreter, gHowl

port_faces = Panel("7654")
port_points = Panel("7128")
udp = UDPReceiver(Port=port_points, Pattern=0)  # -> Info, Data
udp_2 = UDPReceiver(Port=port_faces, Pattern=0)  # -> Info, Data
panel = Panel(udp.Data)
panel_2 = Panel(udp_2.Data)
python = PythonScript(F=udp_2.Data)  # -> out, a
# ---------- python: Python ----------
# F faces
#a=str(F).replace(",","")
a=str(F).replace("]","").replace(",","").replace("'","").split(" ")
# ---------- end python ----------
panel_3 = Panel(udp_2.Info)
panel_4 = Panel(udp.Info)
fragment = TextFragment(Text=udp_2.Data, Start="2", Count="4")
fragment_2 = TextFragment(Text=udp.Data, Start="2", Count="3")
python_2 = PythonScript(F=udp.Data)  # -> out, a; same code as python
deleted_characters = Panel(python.a)
python_3 = PythonScript(D=fragment)  # -> out, a
# ---------- python_3: Python ----------
# Data

n=str(D).replace("'","").replace(",","")

a= int(n) +1
# ---------- end python_3 ----------
python_4 = PythonScript(D=fragment_2)  # -> out, a
# ---------- python_4: Python ----------
# Data
a=str(D).replace("'","")
# ---------- end python_4 ----------
number_of_faces = Panel(python_3.a)
deleted_characters_2 = Panel(python_2.a)
number_of_points = Panel(python_4.a)
partition = PartitionList(List=deleted_characters, Size=number_of_faces)
partition_2 = PartitionList(List=deleted_characters_2, Size=number_of_points)
groups_of_points_and_normals = Panel(partition)
groups_of_points_and_normals_2 = Panel(partition_2)
bang = ExplodeTree(Data=groups_of_points_and_normals)  # -> Branch0, Branch1, Branch2
bang_2 = ExplodeTree(Data=groups_of_points_and_normals_2)  # -> Branch0, Branch1, Branch2, Branch3
cull_i = CullIndex(List=bang.Branch2, Indices="0", Wrap=True)
cull_i_2 = CullIndex(List=bang.Branch0, Indices="0", Wrap=True)
cull_i_3 = CullIndex(List=bang.Branch1, Indices="0", Wrap=True)
# ISSUE!!!!MISING ONE VERTICE: Problem with the last character of the list, it can't be transformed into a number
python_5 = PythonScript(D=cull_i)  # -> out, a
# ---------- python_5: Python ----------
# Data
a= int(D)
# ---------- end python_5 ----------
cull_i_4 = CullIndex(List=bang_2.Branch3, Indices="0", Wrap=True)
panel_5 = Panel(cull_i_4)
cull_i_5 = CullIndex(List=bang_2.Branch2, Indices="0", Wrap=True)
cull_i_6 = CullIndex(List=bang_2.Branch1, Indices="0", Wrap=True)
panel_6 = Panel(python_5.a)
panel_7 = Panel(cull_i_3)
panel_8 = Panel(cull_i_2)
python_6 = PythonScript(D=cull_i_4)  # -> out, a
# ---------- python_6: Python ----------
# Data
a = float(D)
# ---------- end python_6 ----------
pt = ConstructPoint(XCoordinate=cull_i_6, YCoordinate=cull_i_5, ZCoordinate=python_6.a)
triangle = MeshTriangle(CornerA=panel_8, CornerB=panel_7, CornerC=panel_6)
conmesh = ConstructMesh(Vertices=pt, Faces=triangle)
