# Grasshopper definition sender.gh (Grasshopper 0.9.56)
# plug-ins: Python Interpreter, gHowl, LunchBox

platotetra = PlatonicTetrahedron(Plane=PlaneXY(0, 0, 0), Radius=Slider(1, range=0.1..1), Truncation=Slider(0.5, range=0..1))
tri = Triangulate(Mesh=platotetra)  # -> Mesh, Count
demesh = DeconstructMesh(Mesh=tri.Mesh)  # -> Vertices, Faces, Colours, Normals
panel = Panel(demesh.Faces)
python = PythonScript(F=panel)  # -> out, a
# ---------- python: Python ----------
# F faces
import re
pattern = re.compile("\{(.*?)\}")
pat = pattern.findall(F)
ids = pat[0].split(";")
a = ids
# ---------- end python ----------
item = ListItem(List=demesh.Vertices, Index=python.a, Wrap=True)
item_2 = ListItem(List=demesh.Normals, Index=python.a, Wrap=True)
flatten = FlattenTree(Tree=item_2, Path="{0}")
flatten_2 = FlattenTree(Tree=item, Path="{0}")

# ---- group: ordered normals
panel_2 = Panel(flatten)

# ---- group: ordered verts
panel_3 = Panel(flatten_2)

# ----
python_2 = PythonScript(Verts=panel_3, Normals=panel_2)  # -> out, a
# ---------- python_2: Python ----------
# F faces
import re
pattern = re.compile("\{(.*?)\}")
v = pattern.findall(Verts)[0].split(",")
n = pattern.findall(Normals)[0].split(",")
Pw = "1"
a = " ".join([v[0], v[1], v[2], Pw, n[0], n[1], n[2]])
# ---------- end python_2 ----------
address_pattern = Panel("/points")
panel_4 = Panel([address_pattern, python_2.a])
port = Panel("9999")
send_pattern_osc = Panel("999")
udp = UDPSender(Port=port, Pattern=send_pattern_osc, Data=panel_4)
